# Grasshopper definition Ziglee_Spaces.gh (Grasshopper 1.0.8)

# ---- group: 2
geometry = Geometry(<curve referenced from the Rhino model>)
geometry_2 = Geometry([<curve referenced from the Rhino model> x12])
surface = Surface(geometry_2)
surface_2 = Surface(geometry)
unit_z = UnitZ(Factor=Slider(6, range=0..10))
extrude = Extrude(Base=surface, Direction=unit_z)
extrude_2 = Extrude(Base=surface_2, Direction=unit_z)

# ----
geometry_3 = Geometry(<curve referenced from the Rhino model>)
project = Project(Geometry=geometry_3, Plane=PlaneXY(0, 0, 0))  # -> Geometry, Transform
geometry_4 = Geometry([<curve referenced from the Rhino model> x12])
surface_3 = Surface(geometry_4)
surface_4 = Surface(geometry_3)
surface_5 = Surface(project.Geometry)
unit_z_2 = UnitZ(Factor=Slider(6, range=0..10))

geometry_5 = Geometry([<curve referenced from the Rhino model> x12])
surface_6 = Surface(geometry_5)
extrude_3 = Extrude(Base=surface_6, Direction=expr("x*2", unit_z_2))

extrude_4 = Extrude(Base=surface_3, Direction=unit_z_2)
extrude_5 = Extrude(Base=surface_5, Direction=expr("x*2", unit_z_2))
extrude_6 = Extrude(Base=surface_4, Direction=unit_z_2)
move = Move(Geometry=[extrude_4, extrude], Motion=expr("x*2", unit_z_2))  # -> Geometry, Transform
move_2 = Move(Geometry=[extrude_6, extrude_2], Motion=expr("x*2", unit_z_2))  # -> Geometry, Transform
geometry_6 = Geometry([extrude_5, extrude_2, move_2.Geometry])
geometry_7 = Geometry([extrude_4, extrude, move.Geometry])
mesh_brep = MeshBrep(
    Brep=geometry_6,
    Settings={GridMaxCount=0, GridMinCount=16, JaggedSeams=False, MaxEdgeLength=0, MinEdgeLength=0.0001, MinTolerance=0, Refine=True, RefineAngle=0, RelativeTolerance=0.65, SimplePlanes=True, Tolerance=0})

# ---- group: not needed
bounding_box = BoundingBox(Content=flatten([geometry_7, geometry_6]), Plane=PlaneXY(0, 0, 0), UnionBox=True)  # -> Box, Box_2
deconstruct_brep = DeconstructBrep(Brep=bounding_box.Box)  # -> Faces, Edges, Vertices
list_item = ListItem(List=deconstruct_brep.Faces, Index=Slider(4, range=0..5), Wrap=True)
number_slider = Slider(1.2, range=0..2)
scale_nu = ScaleNU(Geometry=bounding_box.Box, Plane=list_item, ScaleX=number_slider, ScaleY=number_slider, ScaleZ=Slider(0.24, range=0..1))  # -> Geometry, Transform
mirror = Mirror(Geometry=scale_nu.Geometry, Plane=list_item)  # -> Geometry, Transform
simple_mesh = SimpleMesh(Brep=mirror.Geometry)

# ----
geometry_8 = Geometry(<mesh referenced from the Rhino model>)
box_array = BoxArray(Geometry=geometry_8, Cell=geometry_8, XCount=Slider(10, range=0..10), YCount=Slider(8, range=0..10), ZCount=2)  # -> Geometry, Transform
mesh_join = MeshJoin(Meshes=mesh_brep)
simple_mesh_2 = SimpleMesh(Brep=extrude_3)
simple_mesh_3 = SimpleMesh(Brep=geometry_7)
